% Simulink data dictionary RegentorquePC_1.sldd

AccPedalAngl = Simulink.Parameter([0; 2; 3; 4; 5; 6; 7; 8; 9; 10])
MotorSpd = Simulink.Parameter([0 300 500 1000 1500 2000 4000 6000 8000 10000])

TrqPC = Simulink.Parameter([0 180 170 160 150 113 110 107 104 101
 0 170 160 140 140 102 105 106 107 110
 0 160 150 140 130 102 104 106 108 120
 0 150 140 130 120 104 105 110 115 120
 0 140 130 120 110 110 115 120 125 130
 0 130 120 110 115 120 125 130 135 140
 0 110 115 120 125 130 135 140 145 150
 0 120 125 130 135 140 145 150 155 160
 0 130 135 140 145 150 155 160 165 170
 0 140 145 150 155 160 165 170 175 180])